# Grasshopper definition test.gh (Grasshopper 1.0.7)
# plug-ins: Bifocals, Kangaroo2 Components

# ---- group: RH_IN:grow
number_slider = Slider(70, range=10..100)

# ---- group: RH_IN:seed
number_slider_2 = Slider(79, range=10..100)

# ----
unit_z = UnitZ(Factor=number_slider)
ellipse = Ellipse(Plane=PlaneXY(0, 0, 0), Radius1=Slider(10, range=3..20), Radius2=Slider(14, range=3..20))  # -> Ellipse, Focus1, Focus2

# ---- group: RH_IN:radius
radius = Slider(16, range=5..20)  # disabled

# ---- group: RH_IN:count
count = Slider(8, range=2..20)  # disabled

# ----
move = Move(Geometry=ellipse.Ellipse, Motion=unit_z)  # -> Geometry, Transform
rotate = Rotate(Geometry=ellipse.Ellipse, Angle="150", Plane=PlaneXY(0, 0, 0))  # -> Geometry, Transform
sph = Sphere(Base=PlaneXY(0, 0, 0), Radius=radius)  # disabled
scale = Scale(Geometry=move.Geometry, Center=Point(0, 0, 0), Factor=0.5)  # -> Geometry, Transform
pt = ConstructPoint(XCoordinate=0, YCoordinate=0, ZCoordinate=0)  # disabled
popgeo = PopulateGeometry(Geometry=sph, Count=count, Seed=1)  # disabled
division = Division(A=radius, B=count)  # disabled
ln = Line(StartPoint=pt, EndPoint=popgeo)  # disabled
geometry = Geometry(move.Geometry)
geometry_2 = Geometry(rotate.Geometry)
geometry_3 = Geometry(scale.Geometry)
loft = Loft(
    Curves=[geometry_2, geometry_3, geometry],
    Options={Adjust=False, Closed=False, LoftEnds=0, LoftSimp=0, LoftType=0, Rebuild=10, Refit=0.01})
mp = MultiPipe(Curves=ln, NodeSize=division, EndOffset=1, StrutSize=1, Segment=0, KinkAngle=0.6, CubeFit=0)  # disabled
meshsubd = MeshFromSubD(SubD=mp, Density=2)  # disabled
populate_geometry = PopulateGeometry(Geometry=loft, Count=number_slider, Seed=number_slider_2)
swatch = ColourSwatch(SwatchColor=RGB(255, 255, 255))  # disabled
construct_point = ConstructPoint(XCoordinate=0, YCoordinate=0, ZCoordinate=0)
construct_domain = ConstructDomain(DomainStart=Slider(1, range=1..20), DomainEnd=Slider(6, range=1..20))
unit_z_2 = UnitZ(Factor=number_slider)
number_slider_3 = Slider(10, range=0..10)
medges = MeshEdges(Mesh=meshsubd)  # -> NakedEdges, InteriorEdges, NonManifoldEdges; disabled
range = Range(Domain=construct_domain, Steps=10)
line_sdl = LineSDL(Start=construct_point, Direction=unit_z_2, Length=number_slider)
point = Point(populate_geometry)
preview = CustomPreview(Geometry=meshsubd, Material=swatch)  # disabled
remap_numbers = RemapNumbers(Value=range, Source=construct_domain, Target=Domain(0, 1))  # -> Mapped, Clipped
random = Random(Range=range, Number=remap_numbers.Mapped, Seed=remap_numbers.Mapped)  # disabled

# ---- group: RH_OUT:edges
crv = Curve([medges.NakedEdges, medges.InteriorEdges])  # disabled

# ----
divide_length = DivideLength(Curve=line_sdl, Length=Slider(3, range=1..5))  # -> Points, Tangents, Parameters

# ---- group: RH_OUT:mesh
mesh = Mesh(meshsubd)  # disabled

# ----
closest_point = ClosestPoint(Point=divide_length.Points, Cloud=point)  # -> ClosestPoint, CPIndex, Distance
panel = Panel(closest_point.ClosestPoint)
sphere = Sphere(Base=panel, Radius=Slider(4, range=1..10))
sphere_2 = Sphere(Base=point, Radius=Slider(2, range=1..10))

# ---- group: RH_OUT:pointsmall
mesh_2 = Mesh(sphere_2)

# ---- group: RH_OUT:pointlarge
mesh_3 = Mesh(sphere)
