# Grasshopper definition test2.gh (Grasshopper 1.0.7)

# ---- group: RH_IN:grow
number_slider = Slider(17, range=10..100)

# ---- group: RH_IN:seed
number_slider_2 = Slider(70, range=10..100)

# ----
cone = Cone(Base=PlaneXY(0, 0, 0), Radius=number_slider, Length=number_slider_2)  # -> Cone, Tip

# ---- group: RH_OUT:mesh
mesh = Mesh(cone.Cone)

# ----
preview = CustomPreview(Geometry=mesh, Material=ColourSwatch(SwatchColor=RGB(242, 136, 94)))
